# Grasshopper definition Facade.gh (Grasshopper 1.0.7)
# plug-ins: ggRhinoIFC, MetaHopper, Human

gggrasshoppersettings = GgGrasshopperSettings(
    SettingsData_IFCSettings_Format="STEP",
    SettingsData_IFCSettings_GenerateOwnerHistory=True,
    SettingsData_IFCSettings_IdentifyObsolete=True,
    SettingsData_IFCSettings_LastUsedUnits="Feet",
    SettingsData_IFCSettings_Radians=True,
    SettingsData_IFCSettings_Target="Universal",
    SettingsData_IFCSettings_VersionIFC="IFC2x3",
    SettingsData_RevitSettings_Format="STEP",
    SettingsData_RevitSettings_GenerateOwnerHistory=True,
    SettingsData_RevitSettings_IdentifyObsolete=True,
    SettingsData_RevitSettings_LastUsedUnits="Feet",
    SettingsData_RevitSettings_Radians=True,
    SettingsData_RevitSettings_Target="Universal",
    SettingsData_RevitSettings_VersionIFC="IFC4")
relative_path = RelativePath(Path="000_Levels_Grids_Content.ifc")
file_path = FilePath(relative_path)
ggifc_readfile = GgIFCReadFile(FilePath=file_path, Transform=True, Filters="IfcBuildingStorey")  # -> Project, Filtered
ggifc_decompose_building_storey = GgIFCDecomposeBuildingStorey(IfcBuildingStorey=ggifc_readfile.Filtered)  # -> Name, Elevation, IFCSpaces, IFCBuildingStoreyProducts, IFCBuildingStoreyGrids, Description, GlobalId
sort_list = SortList(Keys=ggifc_decompose_building_storey.Elevation, ValuesValuesA=ggifc_readfile.Filtered)  # -> Keys, ValuesValuesA
ggifc_decompose_building_storey_2 = GgIFCDecomposeBuildingStorey(IfcBuildingStorey=sort_list.ValuesValuesA)  # -> Name, Elevation, IFCSpaces, IFCBuildingStoreyProducts, IFCBuildingStoreyGrids, Description, GlobalId
match_text = MatchText(Text=ggifc_decompose_building_storey_2.Name, RegEx=".*(Basement|Mez).*", Case=True)
dispatch = Dispatch(List=sort_list.ValuesValuesA, DispatchPattern=match_text)  # -> ListA, ListB
dynamic_geometry_pipeline = DynamicGeometryPipeline(
    LayerFilter="CurtainWall",
    TypeFilter="Block",
    NameFilter="*",
    GroupByLayer=False,
    GroupByType=False,
    IncludeHidden=True,
    IncludeLocked=True,
    enableFullPath=False,
    listenToAttributes=True)
ggifc_decompose_building_storey_3 = GgIFCDecomposeBuildingStorey(IfcBuildingStorey=dispatch.ListB)  # -> Name, Elevation, IFCSpaces, IFCBuildingStoreyProducts, IFCBuildingStoreyGrids, Description, GlobalId
explode_blocks = ExplodeBlocks(BlockObjects=dynamic_geometry_pipeline, explodeGeom=True)  # -> Geometry, Attributes, BlockName, BoundingBox, BlockTransform, InsertionPlane, InstanceCount
construct_point = ConstructPoint(XCoordinate=0, YCoordinate=0, ZCoordinate=ggifc_decompose_building_storey_3.Elevation)
bounding_box = BoundingBox(Content=explode_blocks.Geometry, Plane=PlaneXY(0, 0, 0))  # -> Box, Box_2
brep_plane = BrepPlane(Brep=explode_blocks.Geometry, Plane=construct_point)  # -> Curves, Points
box_corners = BoxCorners(Box=bounding_box.Box)  # -> CornerA, CornerB, CornerC, CornerD, CornerE, CornerF, CornerG, CornerH
deconstruct = Deconstruct(Point=box_corners.CornerE)  # -> XComponent, YComponent, ZComponent
merge = Merge(Data1=flatten(ggifc_decompose_building_storey_3.Elevation), Data2=flatten(deconstruct.ZComponent))
shift_list = ShiftList(List=merge, Shift=1, Wrap=False)
shift_list_2 = ShiftList(List=merge, Shift=-1, Wrap=False)
subtraction = Subtraction(A=shift_list, B=shift_list_2)  # -> graft(Result)
match_tree = MatchTree(Tree=graft(dispatch.ListB), Guide=brep_plane.Curves)
unit_z = UnitZ(Factor=subtraction)
match_tree_2 = MatchTree(Tree=graft(unit_z), Guide=brep_plane.Curves)
clean_tree = CleanTree(
    RemoveNulls=True,
    RemoveInvalid=True,
    RemoveEmpty=True,
    Tree=brep_plane.Curves,
    SynchronousTree1=match_tree,
    SynchronousTree2=match_tree_2)  # -> Tree, SynchronousTree1, SynchronousTree2
ggifc_decompose_building_storey_4 = GgIFCDecomposeBuildingStorey(IfcBuildingStorey=clean_tree.SynchronousTree1)  # -> Name, Elevation, IFCSpaces, IFCBuildingStoreyProducts, IFCBuildingStoreyGrids, Description, GlobalId
offset_curve = OffsetCurve(Curve=clean_tree.Tree, Distance="1", Corners=1)
explode = Explode(Curve=offset_curve, Recursive=True)  # -> Segments, Vertices
extrude = Extrude(Base=explode.Segments, Direction=clean_tree.SynchronousTree2)
ggifc_geometry = GgIFCGeometry(
    BrepOrMesh=extrude,
    Deviation=0.01,
    Tolerance=0.01,
    ShortLine=0.01,
    Merge=False,
    Voids=False,
    Extrusion=True,
    FaceBased=True)
ggifc_product = GgIFCProduct(Host=clean_tree.SynchronousTree1, Type="IfcCurtainWall", Representation=ggifc_geometry)
relative_path_2 = RelativePath(Path="RhinoFacade.IFC")
ggifc_duplicated_bake = GgIFCDuplicatedBake(IfcProject=ggifc_readfile.Project, Path=relative_path_2, Enabled=Button())
panel = Panel(relative_path_2)
